# Grasshopper definition STF_Mesh srf detection_GLB Mesh 1.gh (Grasshopper 1.0.8)
# plug-ins: Pufferfish, Sasquatch, Telepathy

# ---- group: MESH 1
mesh = Mesh(<mesh referenced from the Rhino model>)

# ---- group: MESH 2
mesh_2 = Mesh(<mesh referenced from the Rhino model>)

# ----
scale_nu = ScaleNU(Geometry=mesh, Plane=PlaneXY(0, 0, 0), ScaleX=1, ScaleY=Slider(2, range=0..10), ScaleZ=1)  # -> Geometry, Transform
filter = StreamFilter(Gate=Toggle(True), Stream0=mesh, Stream1=mesh_2)
dist_vertical_sections = Slider(4251, range=0..10000)
mesh_3 = Mesh(filter)
cluster = Cluster(C=mesh_3, B=dist_vertical_sections)  # -> pln_2, pln_5, srf_2, width
# Vertical cut for floor height finding
mesh_4 = RemoteSender(mesh_3)
mesh_5 = MeshBrep(
    Brep=cluster.srf_2,
    Settings={GridMaxCount=0, GridMinCount=16, JaggedSeams=False, MaxEdgeLength=0, MinEdgeLength=0.0001, MinTolerance=0, Refine=True, RefineAngle=0, RelativeTolerance=0.65, SimplePlanes=True, Tolerance=0})
mmx = MeshMesh(MeshA=mesh_3, MeshB=mesh_5)

# ---- group: BB dimnesions (W, L, H)
crv = Curve(cluster.width)

# ----
topoly = CurveToPolyline(Curve=mmx, ToleranceDistance=0, ToleranceAngle=degrees(Slider(45, range=0..100)))  # -> Polyline, Segments
explode = Explode(Curve=topoly.Polyline, Recursive=True)  # -> Segments, Vertices
eval = EvaluateCurve(Curve=reparameterize(explode.Segments), Parameter="0.5")  # -> Point, Tangent, Angle
Z = UnitZ(Factor=1)
tolerance = Slider(0.005, range=0..0.1)
dprod = DotProduct(VectorA=Z, VectorB=eval.Tangent, Unitize=False)
abs = Absolute(Value=dprod)
round = RoundToIncrements(values=abs, factor=tolerance)
equals = Equality(FirstNumber=round, SecondNumber=1)  # -> Equality, Inequality
equals_2 = Equality(FirstNumber=round, SecondNumber=0)  # -> Equality, Inequality

panel = Panel(mmx)

# ---- group: Horizontal
cull = CullPattern(List=explode.Segments, CullPattern=equals_2.Equality)

# ---- group: Verticals
cull_2 = CullPattern(List=explode.Segments, CullPattern=equals.Equality)

# ----
crv_2 = Curve(flatten(cull))
midpt = CurveMiddle(Curve=crv_2)
pdecon = Deconstruct(Point=midpt)  # -> XComponent, YComponent, ZComponent
tolerance_2 = Slider(500, range=0..1000)
sort = SortList(Keys=pdecon.ZComponent, ValuesCrv=crv_2)  # -> Height, ValuesCrv

# ---- group: partition by height max spread value
cluster_2 = Cluster_2(L=sort.Height, L_2=sort.ValuesCrv, B=tolerance_2)  # -> i, C

# ---- group: cull if group has less than X curves in the group
cluster_3 = Cluster_3(data=cluster_2.i, L=cluster_2.C, B=Slider(2, range=0..10))

# ----
viewer = ParamViewer(cluster_3)
lng = ListLength(List=cluster_3)
midpt_2 = CurveMiddle(Curve=cluster_3)
# Would need to find which i is determinant
pln = Plane(cluster.pln_2)
division = Division(A=lng, B=2)
pdecon_2 = Deconstruct(Point=midpt_2)  # -> XComponent, YComponent, ZComponent
split = SplitList(List=cluster_3, Index=division)  # -> ListA, ListB

# ---- group: Bottom Values
data = Data(split.ListB)
len = Length(Curve=data)
midpt_3 = CurveMiddle(Curve=data)
pdecon_3 = Deconstruct(Point=midpt_3)  # -> XComponent, YComponent, ZComponent
multiplication = Multiplication(A=pdecon_3.ZComponent, B=len)
ma = MassAddition(Input=len)  # -> Result, PartialResults
ma_2 = MassAddition(Input=multiplication)  # -> Result, PartialResults
division_2 = Division(A=ma_2.Result, B=ma.Result)

data_2 = Data(split.ListA)
len_2 = Length(Curve=data_2)
midpt_4 = CurveMiddle(Curve=data_2)
pdecon_4 = Deconstruct(Point=midpt_4)  # -> XComponent, YComponent, ZComponent
multiplication_2 = Multiplication(A=pdecon_4.ZComponent, B=len_2)
ma_3 = MassAddition(Input=len_2)  # -> Result, PartialResults
ma_4 = MassAddition(Input=multiplication_2)  # -> Result, PartialResults
division_3 = Division(A=ma_4.Result, B=ma_3.Result)

# ----
len_3 = Length(Curve=crv)
merge = Merge(Data1=division_3, Data2=division_2)
item = ListItem(List=len_3, Index=0, Wrap=True)  # -> Item, Item1, Item2
project = Project(Geometry=pln, Plane=PlaneXY(0, 0, 0))  # -> Geometry, Transform
Z_2 = UnitZ(Factor=merge)
avr = Average(Input=merge)
Z_3 = UnitZ(Factor=avr)
multiplication_3 = Multiplication(A=item.Item, B=1.2)
multiplication_4 = Multiplication(A=item.Item1, B=1.2)
move = Move(Geometry=project.Geometry, Motion=Z_3)  # -> simplify(Geometry), Transform
move_2 = Move(Geometry=project.Geometry, Motion=Z_2)  # -> Geometry, Transform
align_domain = AlignDomain(data=-1, data_2=multiplication_3)
align_domain_2 = AlignDomain(data=-1, data_2=multiplication_4)
slabplanes = RemoteSender(move_2.Geometry)
rectangle = Rectangle(Plane=move_2.Geometry, XSize=align_domain, YSize=align_domain_2, Radius=0)  # -> Rectangle, Length
mesh_6 = MeshBrep(
    Brep=rectangle.Rectangle,
    Settings={GridMaxCount=0, GridMinCount=16, JaggedSeams=False, MaxEdgeLength=0, MinEdgeLength=0.0001, MinTolerance=0, Refine=True, RefineAngle=0, RelativeTolerance=0.65, SimplePlanes=True, Tolerance=0})
mesh_7 = RemoteReceiver(mesh_4)
mmx_2 = MeshMesh(MeshA=mesh_7, MeshB=mesh_6)
trim = TrimTree(Tree=mmx_2, Depth=1)  # -> simplify(Tree)
sort_2 = SortList(Keys=[item.Item, item.Item1])  # -> reverse(Keys), ValuesA
item_2 = ListItem(List=sort_2.Keys, Index=0, Wrap=True)
number_slider = Slider(184, range=0..1000)
cir = Circle(Plane=move.Geometry, Radius=expr("x*1.2", item_2))
project_2 = Project(Geometry=trim, Plane=move.Geometry)  # -> Geometry, Transform
divide = DivideCurve(Curve=cir, Count=number_slider, Kinks=False)  # -> Points, Tangents, Parameters
group = Group(Geometry=project_2.Geometry)
ln = Line(StartPoint=move.Geometry, EndPoint=divide.Points)  # -> simplify(Line)
repeat = RepeatData(Data=group, Length=number_slider)
ungroup = Ungroup(Group=repeat)  # -> simplify(Geometry)
ccx = CurveCurve(CurveA=reparameterize(simplify(graft(ln))), CurveB=ungroup)  # -> Points, ParamsA, ParamsB
slabplanes_2 = RemoteReceiver(slabplanes)
trim_2 = TrimTree(Tree=ccx.Points, Depth=1)
trim_3 = TrimTree(Tree=ccx.ParamsA, Depth=1)
sort_3 = SortList(Keys=trim_3, ValuesA=trim_2)  # -> Keys, ValuesA

# ---- group: GEt in between PLanes for walls
pln_2 = Plane(flatten(slabplanes_2))
cull_i = CullIndex(List=pln_2, Indices=[0, -1], Wrap=True)
partition = PartitionList(List=cull_i, Size="2")
avrpln = AveragePlane(Planes=partition)

# ----
number_slider_2 = Slider(0.15, range=0..1)
item_3 = ListItem(List=reverse(sort_3.ValuesA), Index=0, Wrap=True)
slabplanes_3 = RemoteReceiver(simplify(slabplanes))
item_4 = ListItem(List=partition, Index=0, Wrap=True)
trim_4 = TrimTree(Tree=item_3, Depth=1)
subtraction = Subtraction(A=1, B=number_slider_2)
pline = PolyLine(Vertices=trim_4, Closed=invert(False))
item_5 = ListItem(List=reverse(slabplanes_3), Index=0, Wrap=True)

# ---- group: size between slabs
pdecon_5 = Deconstruct(Point=partition)  # -> XComponent, YComponent, ZComponent
item_6 = ListItem(List=pdecon_5.ZComponent, Index=0, Wrap=True)  # -> Item, Item1
subtraction_2 = Subtraction(A=item_6.Item1, B=item_6.Item)

# ----
merge_2 = Merge(Data1=number_slider_2, Data2=Slider(0.5, range=0..1), Data3=subtraction)
multiplication_5 = Multiplication(A=item.Item, B=1.2)
multiplication_6 = Multiplication(A=item.Item1, B=1.2)
item_7 = ListItem(List=partition, Index=0, Wrap=True)  # -> Item, Item1
project_3 = Project(Geometry=pline, Plane=slabplanes_3)  # -> Geometry, Transform
align_domain_3 = AlignDomain(data=-1, data_2=multiplication_5)
align_domain_4 = AlignDomain(data=-1, data_2=multiplication_6)
twn2plns = TweenTwoPlanes(PlaneA=item_7.Item, PlaneB=item_7.Item1, Factor=merge_2, Quaternion=True)
loft = Loft(
    Curves=project_3.Geometry,
    Options={Adjust=False, Closed=False, LoftEnds=0, LoftSimp=0, LoftType=0, Rebuild=10, Refit=0.01})
cap = CapHoles(Brep=loft)
preview = CustomPreview(Geometry=cap, Material=ColourSwatch(SwatchColor=RGB(71, 197, 255)))
pln_3 = Plane(avrpln)
rectangle_2 = Rectangle(Plane=pln_3, XSize=align_domain_3, YSize=align_domain_4, Radius=0)  # -> Rectangle, Length
panel_2 = Panel(subtraction_2)
mesh_8 = MeshBrep(
    Brep=rectangle_2.Rectangle,
    Settings={GridMaxCount=0, GridMinCount=16, JaggedSeams=False, MaxEdgeLength=0, MinEdgeLength=0.0001, MinTolerance=0, Refine=True, RefineAngle=0, RelativeTolerance=0.65, SimplePlanes=True, Tolerance=0})
mesh_9 = RemoteReceiver(mesh_4)
mmx_3 = MeshMesh(MeshA=mesh_9, MeshB=mesh_8)  # -> simplify(Intersections)
number_slider_3 = Slider(3, range=0..5)

topoly_2 = CurveToPolyline(Curve=mmx_3, ToleranceDistance=0, ToleranceAngle=degrees(Slider(45, range=0..100)))  # -> Polyline, Segments

branch = TreeBranch(Tree=pline, Path=number_slider_3, MaintainPaths=True)
branch_2 = TreeBranch(Tree=mmx_3, Path=number_slider_3, MaintainPaths=True)
number_slider_4 = Slider(184, range=0..1000)
pln_4 = Plane(simplify(pln_3))
branch_3 = TreeBranch(Tree=pln_4, Path=number_slider_3, MaintainPaths=True)
explode_2 = Explode(Curve=mmx_3, Recursive=True)  # -> Segments, Vertices
crv_3 = Curve(mmx_3)
trim_5 = TrimTree(Tree=explode_2.Vertices, Depth=1)
cluster_4 = Cluster_5(R=item_2, relay=number_slider_4, pln=branch_3, crv=branch_2)  # -> W, c

# ---- group: slab outline
crv_4 = Curve(pline)

# ----
X = UnitX(Factor=1)

explode_3 = Explode(Curve=topoly_2.Polyline, Recursive=True)  # -> Segments, Vertices
eval_2 = EvaluateCurve(Curve=reparameterize(explode_3.Segments), Parameter="0.5")  # -> Point, Tangent, Angle
tolerance_3 = Slider(0.02, range=0..0.1)
dprod_2 = DotProduct(VectorA=X, VectorB=eval_2.Tangent, Unitize=False)
abs_2 = Absolute(Value=dprod_2)
round_2 = RoundToIncrements(values=abs_2, factor=tolerance_3)
equals_3 = Equality(FirstNumber=round_2, SecondNumber=1)  # -> Equality, Inequality
equals_4 = Equality(FirstNumber=round_2, SecondNumber=0)  # -> Equality, Inequality

hull2d = ConvexHull(Points=trim_5, Plane=pln_3)  # -> Hull, HullZ, Indices

# ---- group: Horizontal
cull_3 = CullPattern(List=explode_3.Segments, CullPattern=equals_4.Equality)

# ---- group: Verticals
cull_4 = CullPattern(List=explode_3.Segments, CullPattern=equals_3.Equality)

# ----
number_slider_5 = Slider(500, range=0..1000)
number_slider_6 = Slider(1000, range=0..1000)
ext = ExtendCurve(Curve=cull_3, Type=0, Start=number_slider_5, End=number_slider_5)
ext_2 = ExtendCurve(Curve=cull_4, Type=0, Start=number_slider_6, End=number_slider_6)
# Pull edges to slab edges
number_slider_7 = Slider(447.6, range=0..500)
merge_3 = Merge(
    Data1=ColourSwatch(SwatchColor=RGB(255, 92, 92)),
    Data2=ColourSwatch(SwatchColor=RGB(92, 228, 255)),
    Data3=ColourSwatch(SwatchColor=RGB(255, 222, 92)))

cluster_5 = Cluster_5(R=item_2, relay=number_slider_4, pln=pln_4, crv=crv_3)  # -> W, c
project_4 = Project(Geometry=crv_4, Plane=item_5)  # -> Geometry, Transform
tstat = TreeStatistics(Tree=cluster_5.W)  # -> Paths, Length, Count

# ---- group: slab
branch_4 = TreeBranch(Tree=project_4.Geometry, Path=tstat.Paths, MaintainPaths=True)

# ---- group: wall
crv_5 = Curve(cluster_5.W)

# ----
planar = Planar(Curve=branch_4)  # -> Planar, Plane, Deviation
project_5 = Project(Geometry=crv_5, Plane=planar.Plane)  # -> Geometry, Transform
explode_4 = Explode(Curve=project_5.Geometry, Recursive=True)  # -> Segments, Vertices

offset = OffsetCurve(Curve=project_5.Geometry, Distance=expr("-x", Slider(300, range=0..1000)), Corners=1)
connectends = ConnectCurveEnds(Curve1=project_5.Geometry, Curve2=offset, FlipEnds=False)
null = NullItem(Item=connectends)  # -> NullFlags, InvalidFlags, Description
cull_5 = CullPattern(List=connectends, CullPattern=invert(null.InvalidFlags))
boundary = BoundarySurfaces(Edges=cull_5)
Z_4 = UnitZ(Factor=subtraction_2)
extr = Extrude(Base=boundary, Direction=Z_4)

preview_2 = CustomPreview(Geometry=extr, Material=ColourSwatch(SwatchColor=RGB(255, 193, 117)))

crv_6 = Curve(branch_4)

crv_cp = CurveClosestPoint(Point=explode_4.Vertices, Curve=crv_6)  # -> Point, Parameter, Distance

c_script = CSharpScript(Dist=crv_cp.Distance, x=Slider(99.4, range=0..200), y=number_slider_7)  # -> out, simplify(a); inputs Dist: Double, x: Double, y: Double
# ---------- c_script: C# ----------
// Grasshopper Script Instance
#region Usings
using System;
using System.Linq;
using System.Collections;
using System.Collections.Generic;
using System.Drawing;

using Rhino;
using Rhino.Geometry;

using Grasshopper;
using Grasshopper.Kernel;
using Grasshopper.Kernel.Data;
using Grasshopper.Kernel.Types;
#endregion

public class Script_Instance : GH_ScriptInstance
{
    #region Notes
    /* 
      Members:
        RhinoDoc RhinoDocument
        GH_Document GrasshopperDocument
        IGH_Component Component
        int Iteration

      Methods (Virtual & overridable):
        Print(string text)
        Print(string format, params object[] args)
        Reflect(object obj)
        Reflect(object obj, string method_name)
    */
    #endregion

    private void RunScript(double Dist, double x, double y, ref object a)
    {
        // Write your logic here
        if (Dist < x)
        {
            //Wall
            a = 0;
        }
        else if (Dist > y )
        {
            a = 2;
        }
        else{
            a = 1;
        }
    }
}
# ---------- end c_script ----------
cset = CreateSet(List=c_script.a)  # -> Set, Map
sort_4 = SortList(Keys=cset.Set, ValuesA=cset.Set)  # -> Keys, ValuesA
mindex = MemberIndex(Set=c_script.a, Member=sort_4.ValuesA)  # -> Index, Count
item_8 = ListItem(List=c_script.a, Index=mindex.Index, Wrap=True)
item_9 = ListItem(List=explode_4.Vertices, Index=mindex.Index, Wrap=True)
item_10 = ListItem(List=merge_3, Index=item_8, Wrap=True)

ln_2 = Line(StartPoint=crv_cp.Point, EndPoint=explode_4.Vertices)
dots = DotDisplay(Point=item_9, Colour=item_10, Size=Slider(100, range=0..100))

# ==== cluster Cluster
C = ClusterInput()
bbox = BoundingBox(Content=C, Plane=PlaneXY(0, 0, 0))  # -> Box, Box_2
bounding_box_analysis = BoundingBoxAnalysis(boundingbox=bbox.Box)  # -> sorted_measurement, width, length, heigth
boundingbox_base_plate = BoundingboxBasePlate(B=bbox.Box)
area = Area(Geometry=boundingbox_base_plate)  # -> Area, Centroid
explode = Explode(Curve=boundingbox_base_plate, Recursive=True)  # -> Segments, Vertices
dim = Dimensions(Surface=boundingbox_base_plate)  # -> UDimension, VDimension
item = ListItem(List=explode.Segments, Index=0, Wrap=True)  # -> Item, Item1
pln = Plane(area.Centroid)
crv = Curve([bounding_box_analysis.width, bounding_box_analysis.length])
width = ClusterOutput([bounding_box_analysis.width, bounding_box_analysis.length, bounding_box_analysis.heigth])
B = ClusterInput()
pln_2 = ClusterOutput(pln)
len = Length(Curve=[item.Item, item.Item1])
division = Division(A=len, B=B)
crv_2 = Curve(simplify(graft([item.Item, item.Item1])))
round = Round(Number=division)  # -> Nearest, Floor, Ceiling
crv_3 = Curve(reverse(flatten(crv_2)))
divide = DivideCurve(Curve=crv_2, Count=simplify(graft(round.Nearest)), Kinks=False)  # -> Points, Tangents, Parameters
crv_4 = Curve(graft(crv_3))
len_2 = Length(Curve=bounding_box_analysis.heigth)
len_3 = Length(Curve=crv_4)
eval = EvaluateCurve(Curve=crv_2, Parameter=divide.Parameters)  # -> Point, Tangent, Angle
pl = PlaneNormal(Origin=eval.Point, ZAxis=eval.Tangent)
Z = UnitZ(Factor=1)
align = AlignPlane(Plane=pl, Direction=Z)  # -> Plane, Angle
rotate = Rotate(Geometry=align.Plane, Angle=degrees(-90), Plane=align.Plane)  # -> Geometry, Transform
cull_i = CullIndex(List=rotate.Geometry, Indices=[0, -1], Wrap=True)
pln_3 = Plane(cull_i)
rectangle = Rectangle(Plane=pln_3, XSize=len_3, YSize=len_2, Radius=0)  # -> Rectangle, Length
pln_4 = Plane(pln_3)
srf = Surface(rectangle.Rectangle)
pln_5 = ClusterOutput(pln_4)
srf_2 = ClusterOutput(srf)

# ==== cluster Cluster_2
L = ClusterInput()
cset = CreateSet(List=L)  # -> Set, Map
item = ListItem(List=cset.Set, Index=0, Wrap=True)
abs = Absolute(Value=item)
addition = Addition(A=cset.Set, B=abs)
index = ItemIndex(List=addition, Item=addition)
B = ClusterInput()
L_2 = ClusterInput()

data = Data(addition)

# ---- group: Read Distance between heights
data_2 = Data(data)
shift = ShiftList(List=data_2, Shift=1, Wrap=True)
relast = RemoveLastItem(List=data_2, NumberOfItems=1)
relast_2 = RemoveLastItem(List=shift, NumberOfItems=1)
subtraction = Subtraction(A=relast_2, B=relast)

# ---- group: Flag when step is too big
larger = LargerThan(FirstNumber=subtraction, SecondNumber=B)  # -> LargerThan, OrEqualTo
index_2 = ItemIndex(List=subtraction, Item=subtraction)
cull = CullPattern(List=index_2, CullPattern=larger.LargerThan)
addition_2 = Addition(A=cull, B=1)

# ---- group: Get Section lenght
lng = ListLength(List=data)
merge = Merge(Data1=flatten(0), Data2=flatten(addition_2), Data3=reverse(flatten(lng)))
shift_2 = ShiftList(List=merge, Shift=1, Wrap=True)
relast_3 = RemoveLastItem(List=merge, NumberOfItems=1)
relast_4 = RemoveLastItem(List=shift_2, NumberOfItems=1)
subtraction_2 = Subtraction(A=relast_4, B=relast_3)
ma = MassAddition(Input=subtraction_2)  # -> Result, PartialResults

# ----
partition = PartitionList(List=data, Size=subtraction_2)

# ---- group: index per height disparity
partition_2 = PartitionList(List=index, Size=subtraction_2)

# ----
item_2 = ListItem(List=L_2, Index=partition_2, Wrap=True)  # -> simplify(Item)
C = ClusterOutput(partition)
i = ClusterOutput(item_2)

# ==== cluster RoundToIncrements: Round Number to nearst number on a multiplication table of factor
values = ClusterInput()  # Values to be Rounded
factor = ClusterInput()  # Rounding Factor increment (0.5, 1, 5, 10)
num = Number(factor)
num_2 = Number(values)
expression = Expression(x=num_2, y=num, Expression="y*Cint(x/y)")
num_3 = Number(expression)
rounded_values = ClusterOutput(num_3)

# ==== cluster Cluster_3
data = ClusterInput()
data_2 = Data(data)
B = ClusterInput()
L = ClusterInput()

# ---- group: cull if the group has less than x curves
lng = ListLength(List=data_2)
smaller = SmallerThan(FirstNumber=lng, SecondNumber=B)  # -> SmallerThan, OrEqualTo
cull = CullPattern(List=L, CullPattern=invert(smaller.SmallerThan))
cull_2 = CullPattern(List=data_2, CullPattern=invert(smaller.SmallerThan))
clean = CleanTree(RemoveNulls=True, RemoveInvalid=True, RemoveEmpty=invert(False), Tree=cull)
clean_2 = CleanTree(RemoveNulls=True, RemoveInvalid=True, RemoveEmpty=invert(False), Tree=cull_2)
renumber_tree = RenumberTree(relay=clean)
renumber_tree_2 = RenumberTree(relay=clean_2)

# ----
bnd = Bounds(Numbers=renumber_tree)  # disabled
crv = Curve(renumber_tree_2)
crv_2 = ClusterOutput(crv)

# ==== cluster AlignDomain: Aling domain on 2D plane to quickly construct rectangle
data = ClusterInput()
data_2 = ClusterInput()
data_3 = Data(data)
data_4 = Data(data_2)
addition = Addition(A=data_3, B=data_4)
cluster = Cluster_4(A=data_4)
equals = Equality(FirstNumber=data_3, SecondNumber=-1)  # -> Equality, Inequality
dom = ConstructDomain(DomainStart=data_3, DomainEnd=addition)
filter = StreamFilter(Gate=equals.Equality, Stream0=dom, Stream1=cluster)
s_1 = ClusterOutput(filter)

# ==== cluster Cluster_5
crv = ClusterInput()
pln = ClusterInput()
relay = ClusterInput()
crv_2 = Curve(crv)
pln_2 = Plane(pln)
R = ClusterInput()
cir = Circle(Plane=pln_2, Radius=expr("x*1.2", R))
project = Project(Geometry=crv_2, Plane=pln_2)  # -> Geometry, Transform
divide = DivideCurve(Curve=cir, Count=relay, Kinks=False)  # -> Points, Tangents, Parameters
group = Group(Geometry=project.Geometry)
ln = Line(StartPoint=pln_2, EndPoint=divide.Points)  # -> simplify(Line)
repeat = RepeatData(Data=group, Length=relay)
branch = TreeBranch(Tree=ln, Path=Slider(1, range=0..4), MaintainPaths=True)
ungroup = Ungroup(Group=repeat)  # -> simplify(Geometry)
eval = EvaluateCurve(Curve=branch, Parameter=Slider(0.06, range=0..1))  # -> Point, Tangent, Angle
ccx = CurveCurve(CurveA=reparameterize(simplify(graft(ln))), CurveB=ungroup)  # -> Points, ParamsA, ParamsB
points = PointList(Points=eval.Point, Size=Slider(20, range=0..100))
trim = TrimTree(Tree=ccx.Points, Depth=1)
trim_2 = TrimTree(Tree=ccx.ParamsA, Depth=1)
lng = ListLength(List=trim_2)
equals = Equality(FirstNumber=lng, SecondNumber=0)  # -> Equality, Inequality
sort = SortList(Keys=trim_2, ValuesA=trim)  # -> Keys, ValuesA
item = ListItem(List=reverse(sort.ValuesA), Index=0, Wrap=True)
pt = Point(flatten(item))
trim_3 = TrimTree(Tree=item, Depth=1)
clean = CleanTree(RemoveNulls=True, RemoveInvalid=True, RemoveEmpty=False, Tree=trim_3)
c_script = CSharpScript(pts=clean, t=Slider(2000, range=0..5000))  # -> out, a, b, c; inputs pts: list of Point3d, t: Double
# ---------- c_script: C# ----------
// Grasshopper Script Instance
#region Usings
using System;
using System.Linq;
using System.Collections;
using System.Collections.Generic;
using System.Drawing;

using Rhino;
using Rhino.Geometry;

using Grasshopper;
using Grasshopper.Kernel;
using Grasshopper.Kernel.Data;
using Grasshopper.Kernel.Types;
#endregion

public class Script_Instance : GH_ScriptInstance
{
    #region Notes
    /* 
      Members:
        RhinoDoc RhinoDocument
        GH_Document GrasshopperDocument
        IGH_Component Component
        int Iteration

      Methods (Virtual & overridable):
        Print(string text)
        Print(string format, params object[] args)
        Reflect(object obj)
        Reflect(object obj, string method_name)
    */
    #endregion

    private void RunScript(
		List<Point3d> pts,
		double t,
		ref object a,
		ref object b,
		ref object c)
    {
        // Write your logic here
        cullingIndex.Clear();
        trackSideTrack.Clear();
        bool farAway = false;


        for(int i =1; i < pts.Count; i++)
        {
            var tempPt = pts[i];
            if(farAway == false)
            {
                if(tempPt.DistanceTo(pts[i-1]) > t)
                {
                    farAway = true;
                    trackSideTrack.Add(farAway);
                    cullingIndex.Add(i);
                }
            }
            else{
                if(tempPt.DistanceTo(pts[i-1]) < t)
                {
                    cullingIndex.Add(i);
                }
                else{
                    //We are doing a big jump again (probably coming back)
                    farAway = false;
                    trackSideTrack.Add(farAway);
                }
            }
        }
        if(trackSideTrack.Count % 2 == 1)
        {
            c = cullingIndex[0];
            cullingIndex.Clear();
        }
        
        b = trackSideTrack.Count % 2;
        a = cullingIndex;
    }
    List<int> cullingIndex = new List<int>();
    List<bool> trackSideTrack = new List<bool>();

}
# ---------- end c_script ----------
subtraction = Subtraction(A=c_script.c, B=1)
null = NullItem(Item=c_script.c)  # -> NullFlags, InvalidFlags, Description
cull_i = CullIndex(List=clean, Indices=c_script.a, Wrap=True)
cull = CullPattern(List=c_script.c, CullPattern=invert(null.NullFlags))
cull_2 = CullPattern(List=subtraction, CullPattern=invert(null.NullFlags))
pline = PolyLine(Vertices=cull_i, Closed=invert(False))
panel = Panel(cull_2)
c = ClusterOutput(c_script.c)
item_2 = ListItem(List=clean, Index=[cull, cull_2], Wrap=True)
crv_cp = CurveClosestPoint(Point=item_2, Curve=pline)  # -> Point, Parameter, Distance
avr = Average(Input=item_2)
shatter = Shatter(Curve=pline, Parameters=crv_cp.Parameter)
null_2 = NullItem(Item=avr)  # -> NullFlags, InvalidFlags, Description
crv_cp_2 = CurveClosestPoint(Point=avr, Curve=shatter)  # -> Point, Parameter, Distance
sort_2 = SortList(Keys=crv_cp_2.Distance, ValuesA=shatter)  # -> Keys, ValuesA
# track jumping
bool = Boolean(invert(null_2.NullFlags))
cull_i_2 = CullIndex(List=sort_2.ValuesA, Indices=0, Wrap=True)
weave = Weave(Pattern=bool, Stream0=simplify(pline), Stream1=simplify(cull_i_2), NullGaps=False)
W = ClusterOutput(weave)

# ==== cluster BoundingboxBasePlate: Boundingbox base plate
B = ClusterInput()
debrep = DeconstructBrep(Brep=B)  # -> Faces, Edges, Vertices
area = Area(Geometry=debrep.Faces)  # -> Area, Centroid
pdecon = Deconstruct(Point=area.Centroid)  # -> XComponent, YComponent, ZComponent
sort = SortList(Keys=pdecon.ZComponent, ValuesA=debrep.Faces)  # -> Keys, ValuesA
item = ListItem(List=sort.ValuesA, Index=0, Wrap=True)
crv = Curve(item)
crv_2 = ClusterOutput(crv)

# ==== cluster BoundingBoxAnalysis: Bounding Box Analysis: Retrieve heigth, width and length of bounding box
boundingbox = ClusterInput()  # Bounding Box to Analyse
debrep = DeconstructBrep(Brep=boundingbox)  # -> Faces, Edges, Vertices
item = ListItem(List=debrep.Edges, Index=[0, 5, 11], Wrap=True)
item_2 = ListItem(List=item, Index=0, Wrap=True)  # -> Item, Item1, Item2
len = Length(Curve=item)
len_2 = Length(Curve=[item_2.Item, item_2.Item1])
sort = SortList(Keys=len)  # -> Keys, ValuesA
sort_2 = SortList(Keys=len_2, ValuesA=[item_2.Item, item_2.Item1])  # -> Keys, ValuesA
sorted_measurement = ClusterOutput(sort.Keys)
item_3 = ListItem(List=sort_2.ValuesA, Index=0, Wrap=True)  # -> Item, Item1
width = ClusterOutput(item_3.Item)
length = ClusterOutput(item_3.Item1)
heigth = ClusterOutput(item_2.Item2)

# ==== cluster RenumberTree: Renumber Tree
relay = ClusterInput()
tstat = TreeStatistics(Tree=relay)  # -> Paths, Length, Count
branch = TreeBranch(Tree=relay, Path=tstat.Paths, MaintainPaths=False)
relay_2 = ClusterOutput(branch)

# ==== cluster Cluster_4
A = ClusterInput()
division = Division(A=A, B=2)
multiplication = Multiplication(A=division, B=-1)
dom = ConstructDomain(DomainStart=multiplication, DomainEnd=division)
I = ClusterOutput(dom)
